# Grasshopper definition SDMMinSurf.ghx (Grasshopper 0.9.76)
# plug-ins: MeshEdit Components, Python Interpreter

mesh = Mesh(<mesh referenced from the Rhino model>)
pt = Point(<point referenced from the Rhino model>)
find_mesh_vertices = PythonScript(mesh=mesh, points=pt)  # -> fixed; inputs points: list
# ---------- find_mesh_vertices: Python ----------
"""Wrapper component for the meshminimizehelpers.mesh_close_vertices()
method.
"""

from meshminimizehelpers import mesh_closest_vertices

fixed = mesh_closest_vertices(mesh, points)
# ---------- end find_mesh_vertices ----------
number_slider = Slider(0, range=0..100)
cables = Curve([<curve referenced from the Rhino model> x4])
q_cables = Slider(10000, range=0..10000)
max_disp = Slider(0.001, range=0..0.01)
max_iter = Slider(100, range=0..100)
pressure = Slider(10, range=-10..10)
define_edges = PythonScript(mesh=mesh, q_cables=q_cables, fixed_cable_ends=Toggle(True))  # -> SDMEdges; inputs fixed: list, cables: list of Curve, q_cables: list
# ---------- define_edges: Python ----------
"""
Wrapper block for defining the edges of the problem: cables and fixed-points
"""

import rhinoscriptsyntax as rs
import meshminimizehelpers as mmh
from imp import reload

class SDMEdges:
    """
    Emulates a custom type for the edges of the problem
    """
    
    def __init__(self, cables, q_cables, vertices, naked, fixed):
        """
        Initiate cables and edges with dedicated method from meshminimize
        """
        self.cables = cables
        self.q_cables = q_cables
        (self.ql, self.n_cable, self.fixed) = mmh.define_cables(cables, q_cables,
                                                        vertices, naked, fixed)
        
    def __str__(self):
        """Simple display for error checking"""
        str = ''
        for key in self.__dict__:
            str += "%s: %s\n" % (key, self.__dict__[key])
        return str
        
"""Create default fixed points parameter"""
if not fixed:
    if not cables:
        #Edges are fixed when no cables are defined
        fixed = rs.MeshNakedEdgePoints(mesh)
    else:
        # Fixed points will be defined by mm.define_cables, initialize to
        # none fixed
        fixed = [False for i in rs.MeshVertices(mesh)]
        
"""Create default cables density parameter"""
if not q_cables:
    #Default: 1
    q_cables = [1 for i in cables]
elif len(q_cables) == 1:
    #Allows to pass in one number for all cables
    q_cables = [q_cables[0] for i in cables]
        
        
SDMEdges = SDMEdges(
                cables,
                q_cables,
                rs.MeshVertices(mesh),
                rs.MeshNakedEdgePoints(mesh),
                fixed
                )
# ---------- end define_edges ----------
sdm_options = PythonScript(
    save_results=Toggle(False),
    max_disp=max_disp,
    max_iter=max_iter,
    max_iter_qs=Slider(6, range=0..10),
    max_dev_sigma=Slider(0.01, range=0..10),
    speed=Slider(1, range=0..1),
    method="fixed-point",
    pressure=pressure)  # -> options; inputs max_iter: Int32
# ---------- sdm_options: Python ----------
"""
Block externalizing options for the solver
"""

class SDMOptions:
    """
    Emulates a custom type to pass the options to the solver
    """
    
    def __init__(self, max_disp, max_iter, max_iter_qs, max_dev_sigma, speed,
                 method, pressure):
        self.save_results = save_results
        self.max_disp = max_disp
        self.max_iter = max_iter
        self.max_iter_qs = max_iter_qs
        self.max_dev_sigma = max_dev_sigma
        self.speed = speed
        self.method = method
        self.pressure = pressure
        
    def __str__(self):
        """Simple display for error checking"""
        str = ''
        for key in self.__dict__:
            str += "%s: %s\n" % (key, self.__dict__[key])
        return str
            
options = SDMOptions(max_disp, max_iter, max_iter_qs, max_dev_sigma, speed,
                     method, pressure)
# ---------- end sdm_options ----------
panel = Panel(sdm_options)
define_problem = PythonScript(mesh=mesh, q_faces=Slider(1, range=0..1), SDMEdges=define_edges)  # -> SDMMesh; inputs mesh: Mesh, q_faces: list
# ---------- define_problem: Python ----------
"""
Block for outsourcing the mesh problem definitions
"""

import rhinoscriptsyntax as rs
import copy

class SDMMesh:
    """
    Emulates a custom type to pass the mesh problem to the solver
    """
    
    def __init__(self, mesh, SDMEdges, q_faces, reference):
        self.cables = SDMEdges.cables
        self.fixed = SDMEdges.fixed
        self.q_faces = copy.deepcopy(q_faces)
        self.ql = SDMEdges.ql
        self.q_cables = SDMEdges.q_cables
        self.n_cable = SDMEdges.n_cable
        self.mesh = mesh
        self.reference = reference
        
    def __str__(self):
        """Simple display for error checking"""
        str = ''
        for key in self.__dict__:
            str += "%s: %s\n" % (key, self.__dict__[key])
        return str
        
        
#Create defaults (1) for the surface density
if not q_faces:
    q_faces = [1 for i in range(rs.MeshFaceCount(mesh))]
elif len(q_faces) == 1:
    q_faces = [q_faces[0] for i in range(rs.MeshFaceCount(mesh))]
print q_faces
#Create defaults (current mesh) for the reference mesh
if not reference: reference = rs.MeshVertices(mesh)

SDMMesh = SDMMesh(mesh, SDMEdges, copy.deepcopy(q_faces), reference)
# ---------- end define_problem ----------
solver = PythonScript(toggle=Toggle(True), SDMMesh=define_problem, SDMCables=define_edges, options=sdm_options)  # -> mesh_out, displacements, F_membrane, F_cable, F_pressure, stresses, convergence; inputs toggle: Boolean, SDMCables: list
# ---------- solver: Python ----------
#!/usr/bin/env python
# -*- coding: utf-8 -*-

"""
Wrapper block encapsulating the meshminimize module
"""

from imp import reload
import meshminimize as mm
import rhinoscriptsyntax as rs
import ghpythonlib.components as ghcomp
import copy

reload(mm)

#Pass options to the MeshMinimize module
for key in options.__dict__:
    mm.__dict__[str.upper(key)] = options.__dict__[key]
qs = [1 for i in range(rs.MeshFaceCount(SDMMesh.mesh))]

if toggle:
    vertices, out = mm.minimize_mesh(
                        SDMMesh.mesh,
                        SDMMesh.cables, 
                        fixed=SDMMesh.fixed, 
                        #qs=copy.deepcopy(SDMMesh.q_faces), 
                        qs=qs,
                        q_cables=SDMMesh.q_cables, 
                        reference=SDMMesh.reference, 
                        ql=SDMMesh.ql, 
                        n_cable=SDMMesh.n_cable,
                        P=options.pressure
                        )
else:
    vertices = rs.MeshVertices(SDMMesh.mesh)
    

mesh_out = rs.AddMesh(vertices, rs.MeshFaceVertices(SDMMesh.mesh))

displacements = [rs.VectorCreate(v1, v2) for (v1, v2) in zip(rs.MeshVertices(SDMMesh.mesh), vertices)]

F_membrane = out['M']
F_cable = out['C']
F_pressure = out['P']
stresses = out['S']
convergence = out['convergence']
# ---------- end solver ----------
panel_2 = Panel(solver.stresses)
bnd = Bounds(Numbers=solver.stresses)
dedomain = DeconstructDomain(Domain=bnd)  # -> Start, End
gradient = Gradient(
    LowerLimit=dedomain.Start,
    UpperLimit=dedomain.End,
    Parameter=solver.stresses,
    stops=[0.249: RGB(255, 0, 0), 0.503: RGB(255, 255, 0), 0.755: RGB(0, 255, 0)])
panel_3 = Panel(define_problem)
explode = MeshExplode(Mesh=solver.mesh_out, Interpolate=False)
mcol = MeshColours(Mesh=graft(explode), Colours=graft(gradient))
